# Grasshopper definition heart.gh (Grasshopper 0.9.80)
# plug-ins: Weaverbird

thickness = Slider(5, range=0..10)
box = Box({Plane=PlaneXY(-50, -50, 0), X=Domain(0, 100), Y=Domain(0, 100), Z=Domain(0, 100)})
pop3d = Populate3D(Region=box, Count=Slider(5, range=2..10), Seed=Slider(35, range=0..100))
area = Area(Geometry=box)  # -> Area, Centroid
vcell = VoronoiCell(Point=area.Centroid, Neighbours=pop3d)
debrep = DeconstructBrep(Brep=vcell)  # -> Faces, Edges, Vertices
crv = Curve(debrep.Faces)
wbframe = WeaverbirdsPictureFrame(MeshPolylines=crv, Distance=5, InsetType=0)
wboffset = WeaverbirdsOffsetMesh(MeshCurves=wbframe, Distance=thickness, OffsetType=0)
wbcatmullclark = WeaverbirdsCatmullClarkSubdivision(MeshCurves=wboffset, Level=3, SmoothNakedEdges=1)
